# Grasshopper definition builder_test.gh (Grasshopper 1.0.8)
# plug-ins: Selva

ui_builder = UIBuilder(
    Enable=Toggle(True),
    Schema="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",
    SessionId="dyLL5n-E",
    Values="{\"3a1707e3-f116-4442-8a8d-d66777808bd4\":\"Example Text\",\"8426f660-a18e-44bf-8529-89e5a32fd753\":\"Rect\",\"e62a2ebe-2158-41c4-bf95-b31c862c5257\":\"false\",\"12e4b4b9-2767-426b-baa5-0a0e1bcd0a5b\":11}")  # -> SessionID, Info, Schema
change = Slider(7, range=0..20)
value_list = ValueList({"Square": 1, "Rect": 2, "Round": 3}, selected="Rect")
panel = Panel(ui_builder.Info)
schema = ContextPrint(Schema=ui_builder.Schema)
number_input = GetNumber(change, AtLeast=1, AtMost=1, Maximum=25, Minimum=5, TreeAccess=False)
text_input = GetString("Example Text", AtLeast=1, AtMost=1, TreeAccess=False)
get_boolean = GetBoolean("false", AtLeast=1, AtMost=1, FalseValue="False", TreeAccess=False, TrueValue="True")
value_list_2 = GetValueList(value_list, AtLeast=1, AtMost=1, Immediate=True, TreeAccess=False)
sphere = Sphere(Base=PlaneXY(0, 0, 0), Radius=number_input)
multiplication = Multiplication(A=number_input, B=Slider(2, range=0..10))
panel_2 = Panel(get_boolean)
unit_x = UnitX(Factor=multiplication)
panel_3 = Panel(text_input)
number = Number(number_input)
linear_array = LinearArray(Geometry=sphere, Direction=unit_x, Count="40")  # -> Geometry, Transform
addition = Addition(A=number, B=Slider(100, range=0..1000))
texterop = ContextPrint(ThisIsTheMainPut=addition)
three_material = ThreeMaterial(Color=RGB(255, 255, 255), Metalness=0, Roughness=0.5, Opacity=1, Transparent=False)
display = Display(Geo=linear_array.Geometry, ThreeMaterial=three_material)
name_that_should_not_be_named = ContextBake(OutPutName=display)
