# Grasshopper definition builder_test.gh (Grasshopper 1.0.8)
# plug-ins: Selva

ui_bridge = UIBridge(Enable=Toggle(True), Schema="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", SessionId="eDb_0CwX")  # -> SessionID, Info, Schema
schema = ContextPrint(Schema=ui_bridge.Schema)

types = ValueList({"Sphere": 0, "Cylinder": 1, "Box": 2}, selected="Sphere")
radius = Slider(7, range=0..20)
heigth = Slider(10, range=10..20)
width = Slider(10, range=10..20)
copy_up = GetBoolean("false", AtLeast=1, AtMost=1, FalseValue="False", TreeAccess=False, TrueValue="True")
radius_2 = GetNumber(radius, AtLeast=1, AtMost=1, Maximum=25, Minimum=5, TreeAccess=False)
width_2 = GetNumber(heigth, AtLeast=1, AtMost=1, Maximum=20, Minimum=5, TreeAccess=False)
heigth_2 = GetNumber(width, AtLeast=1, AtMost=1, Maximum=20, Minimum=5, TreeAccess=False)
get_value_list = GetValueList(
    types,
    AtLeast=1,
    AtMost=1,
    Immediate=True,
    StoredItems="""[
  {
    "name": "Sphere",
    "expression": "0"
  },
  {
    "name": "Cylinder",
    "expression": "1"
  },
  {
    "name": "Box",
    "expression": "2"
  }
]""",
    TreeAccess=False)
cylinder = Cylinder(Base=PlaneXY(0, 0, 0), Radius=radius_2, Length=heigth_2)
sphere = Sphere(Base=PlaneXY(0, 0, 0), Radius=radius_2)
center_box = CenterBox(Base=PlaneXY(0, 0, 0), X=radius_2, Y=width_2, Z=heigth_2)
cap_holes = CapHoles(Brep=cylinder)
ui_schema = UISchema(Name="Untitled")
stream_filter = StreamFilter(Gate=get_value_list, Stream0=sphere, Stream1=cap_holes, Stream2=center_box)
bounding_box = BoundingBox(Content=stream_filter, Plane=PlaneXY(0, 0, 0))  # -> Box, Box_2
deconstruct_box = DeconstructBox(Box=bounding_box.Box)  # -> Plane, X, Y, Z
unit_z = UnitZ(Factor=deconstruct_box.Z)
move = Move(Geometry=stream_filter, Motion=unit_z)  # -> Geometry, Transform
merge = Merge(Data1=stream_filter, Data2=move.Geometry)  # -> flatten(Result)
stream_filter_2 = StreamFilter(Gate=copy_up, Stream0=stream_filter, Stream1=merge)
material_color = ColourSwatch(SwatchColor=RGB(199, 165, 165))
three_material = ThreeMaterial(Color=material_color, Metalness="0.95", Roughness="0.25", Opacity=1, Transparent=False)
repeat_data = RepeatData(Data=stream_filter_2, Length="400")
area = Area(Geometry=stream_filter_2)  # -> Area, Centroid
geometry_to_file = GeometryToFile(Geometry=stream_filter_2, FileNames="Test", FileEnding=".3dm")
display = Display(Geo=repeat_data, ThreeMaterial=three_material)
bake = ContextBake(Content=geometry_to_file)
print = ContextPrint(Print=area.Area)
display_2 = ContextBake(Content=display)
